# Grasshopper definition machineDrawing.ghx (Grasshopper 1.0.4)
# plug-ins: Python Interpreter, Silkworm

randomize = Button()
python = PythonScript(x=randomize)  # -> out, a
# ---------- python: Python ----------
__author__ = "leondo"

import rhinoscriptsyntax as rs

from random import randint
a = (randint(5,10))
print "Points: %d mm"  %a
# ---------- end python ----------
python_2 = PythonScript(x=randomize)  # -> out, a
# ---------- python_2: Python ----------
__author__ = "leondo"

import rhinoscriptsyntax as rs

from random import randint
a = (randint(3,6))
print "Depth: %d mm"  %a
# ---------- end python_2 ----------
python_3 = PythonScript(x=randomize)  # -> out, a
# ---------- python_3: Python ----------
__author__ = "leondo"

import rhinoscriptsyntax as rs

from random import randint
a = (randint(300,400))
print "Height: %d mm"  %a
# ---------- end python_3 ----------
python_4 = PythonScript(x=randomize)  # -> out, a
# ---------- python_4: Python ----------
__author__ = "leondo"

import rhinoscriptsyntax as rs

from random import randint
a = (randint(300,400))
print "OG Depth: %d mm"  %a
# ---------- end python_4 ----------
python_5 = PythonScript(x=randomize)  # -> out, a
# ---------- python_5: Python ----------
__author__ = "leondo"

import rhinoscriptsyntax as rs

from random import randint
a = (randint(300,400))
print "Width: %d mm"  %a
# ---------- end python_5 ----------
panel = Panel([python_5.out, python_3.out, python_2.out, python.out])
number = Number(0.5)
sph = Sphere(Base=PlaneXY(0, 0, 0), Radius=number)
xy = XYPlane(Origin=Point(0, 0, 0))
scale_nu = ScaleNU(Geometry=sph, Plane=xy, ScaleX=python_5.a, ScaleY=python_3.a, ScaleZ=python_4.a)  # -> Geometry, Transform
pop3d = Populate3D(Region=scale_nu.Geometry, Count=python.a, Seed=1)
intcrv_t = InterpolateT(Vertices=pop3d, Degree=3, TangentStart=Vector(0, 0, 0), TangentEnd=Vector(0, 0, 0), KnotStyle=1)  # -> Curve, Length, Domain
connect = ConnectCurves(Curves=intcrv_t.Curve, Continuity=2, Close=True, Bulge=1)
num = Number(python_2.a)
division = Division(A=num, B=python_4.a)
scale_nu_2 = ScaleNU(Geometry=connect, Plane=PlaneXY(0, 0, 0), ScaleX=1, ScaleY=1, ScaleZ=division)  # -> Geometry, Transform
division_2 = Division(A=num, B=-2)
Z = UnitZ(Factor=division_2)
move = Move(Geometry=scale_nu_2.Geometry, Motion=Z)  # -> Geometry, Transform
loadsettings = LoadSettings(String=["absolute_extrudersteps = 1", "acceleration = 0", "bed_size = 200,200", "bed_temperature = 60", "bridge_fan_speed = 100", "bridge_flow_ratio = 1", "bridge_speed = 20", "brim_width = 3", "complete_objects = 0", "cooling = 0"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])
silkworm = SilkwormGenerator(SettingsDictionary=loadsettings, Geometry=flatten(move.Geometry), Sort=1)  # -> GCode, SilkwormModel
panel_2 = Panel(silkworm.GCode)
